# Grasshopper definition GHSolar_Test.gh (Grasshopper 0.9.76)
# plug-ins: GHSolar

srf = Surface(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)
panel = Panel("""0
1
2
3
4
5
6""")
panel_2 = Panel("""0
1
2
3
4
5
6""")

# ---- group: DNI Direct Normal Radiation
data = Data(["key:location/dataType/units/frequency/startsAt/endsAt", "Zuerich-Kloten", "Direct Normal Radiation", "Wh/m2", "Hourly", "(1, 1, 1)"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])

# ---- group: DHI Diffuse Horizontal Radiation
data_2 = Data(["key:location/dataType/units/frequency/startsAt/endsAt", "Zuerich-Kloten", "Diffuse Horizontal Radiation", "Wh/m2", "Hourly", "(1, 1, 1)"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])

# ----
mesh_uv = MeshSurface(Surface=srf, UCount=Slider(10, range=0..100), VCount=Slider(10, range=0..100), Overhang=True, Equalize=False)
srf_2 = Surface(<surface referenced from the Rhino model>)
cull_i = CullIndex(List=data, Indices=panel, Wrap=True)
cull_i_2 = CullIndex(List=data_2, Indices=panel_2, Wrap=True)

# ---- group: Latitude
panel_3 = Panel("47.367347")

# ---- group: Longitude
panel_4 = Panel("8.5500025")

# ----
mesh_uv_2 = MeshSurface(Surface=srf_2, UCount="2", VCount="2", Overhang=True, Equalize=False)
item = ListItem(List=flatten(mesh_uv_2), Index=0, Wrap=True)
mesh = Mesh(item)
irrmshh = IrradiationMeshhour(
    AnalysisMesh=mesh,
    Φ=panel_3,
    Λ=panel_4,
    DNI=cull_i,
    DHI=cull_i_2,
    Year="2013",
    Month="1",
    Day="1",
    Hour="10",
    SkydomeResolution="1")  # -> TotalI, Ib, Ih
panel_5 = Panel(cull_i)
panel_6 = Panel(cull_i_2)
panel_7 = Panel(irrmshh.TotalI)
panel_8 = Panel(irrmshh.Ih)
panel_9 = Panel(irrmshh.Ib)
